# Grasshopper definition OpenAI.ghx (Grasshopper 1.0.7)
# plug-ins: brain_ghplugin

env_var = EnvironmentVariable(Name="openai")
panel = Panel("Stock photo of AI working hard to be useful, realistic, cg, 4K, raytraced")
path = FilePath("C:\Users\Lin\Pictures\img-FNYMlAdcwTKaEHVwaXhfTtdC.png")
path_2 = FilePath("C:\Users\Lin\Pictures\mask.png")
path_3 = FilePath("C:\Users\Lin\Pictures\img-46nnGbvUQ5iPijQ0Tm5wUKcq.png")
path_4 = FilePath("C:\Users\Lin\Downloads\Apollo13-wehaveaproblem.mp3")
path_5 = FilePath("C:\Users\Lin\Downloads\2020 Year-End Celebration.mp3")
path_6 = FilePath("C:\Users\Lin\Downloads\example_problem.jsonl")
transcribes = CreateTranscription(Send=Toggle(False), Authorization=env_var, Timeout=10000, FilePath=path_4, ShowAdvanced=False)  # -> Response, JSON, Text, SRT, VJSON, VTT
translate = CreateTranslation(Send=Toggle(False), Authorization=env_var, Timeout=10000, FilePath=path_5, ShowAdvanced=False)  # -> Response, JSON, Text, SRT, VJSON, VTT
files = ListFiles(Send=Toggle(False), Authorization=env_var, Timeout=10000)  # -> Response, Files
upload = UploadFile(Send=Toggle(False), Authorization=env_var, Timeout=10000, FilePath=path_6, Purpose="fine-tune")  # -> Response, ID
delete = DeleteFile(Send=Toggle(False), Authorization=env_var, Timeout=10000, ID="file-XjGxS3KTG0uNmNOK362iJua3")  # -> Response, Success
file = RetrieveFiles(Send=Toggle(False), Authorization=env_var, Timeout=10000, ID="file-XjGxS3KTG0uNmNOK362iJua3")
embeddings = CreateEmbeddings(Send=Toggle(False), Authorization=env_var, Timeout=10000, Input="The food was delicious", ShowAdvanced=False)  # -> Response, Embedding
imageedit = CreateImageEdit(
    Send=Toggle(False),
    Authorization=env_var,
    Timeout=10000,
    Image=path,
    Mask=path_2,
    Prompt="Angry bear with fiery eyes",
    ShowAdvanced=False)  # -> Response, URL, Base64
imagevariation = CreateImageVariation(Send=Toggle(False), Authorization=env_var, Timeout=10000, Image=path_3, ShowAdvanced=False)  # -> Response, URL, Base64
models = ListModels(Send=Toggle(False), Authorization=env_var, Timeout=10000)  # -> Response, Models
completion = CreateCompletion(Send=Toggle(False), Authorization=env_var, Timeout=10000, Prompt="AI is becoming mainstream", ShowAdvanced=False)  # -> Response, Options
chat = CreateChatCompletion(Send=Toggle(False), Authorization=env_var, Timeout=10000, Content="What is your purpose?", ShowAdvanced=False)  # -> Response, Options
edit = CreateEdit(
    Send=Toggle(False),
    Authorization=env_var,
    Timeout=10000,
    Input="A flying dragon",
    Instruction="Write a conventional haiku",
    ShowAdvanced=False)  # -> Response, Result
image = CreateImage(Send=Toggle(False), Authorization=env_var, Timeout=10000, Prompt=panel, ShowAdvanced=False)  # -> Response, URL, Base64
tobitmap = ConvertToBitmap(URL=imageedit.URL, Base64=imageedit.Base64)
tobitmap_2 = ConvertToBitmap(URL=imagevariation.URL, Base64=imagevariation.Base64)
panel_2 = Panel([transcribes.JSON, transcribes.Text, transcribes.SRT, transcribes.VJSON, transcribes.VTT])
panel_3 = Panel([translate.JSON, translate.Text, translate.SRT, translate.VJSON, translate.VTT])
panel_4 = Panel(files.Files)
panel_5 = Panel(upload.ID)
panel_6 = Panel(embeddings.Embedding)
panel_7 = Panel(models.Models)
panel_8 = Panel(completion.Options)
panel_9 = Panel(chat.Options)
panel_10 = Panel(edit.Result)
tobitmap_3 = ConvertToBitmap(URL=image.URL, Base64=image.Base64)
panel_11 = Panel(delete.Success)
panel_12 = Panel(file)
viewer = ImageViewer(Bitmap=tobitmap_3)
viewer_2 = ImageViewer(Bitmap=tobitmap)
viewer_3 = ImageViewer(Bitmap=tobitmap_2)
path_7 = FilePath("C:\Users\Lin\Pictures\")
savebitmap = SaveBitmapLocally(Dir=path_7, Bitmap=tobitmap_3, Save=Toggle(False))
panel_13 = Panel(savebitmap)
