# Grasshopper definition testing_workbench.ghx (Grasshopper 1.0.7)
# plug-ins: jSwan, brain_ghplugin

panel = Panel("https://api.twitter.com/2/tweets/search/recent?query=%23ComputationalDesign")
environment_variable = EnvironmentVariable(Name="OPENAI_API_KEY")
environment_variable_2 = EnvironmentVariable(Name="TWITTER_API_KEY")
panel_2 = Panel("""{
    "model": "text-davinci-003",
    "prompt": "Tell me a fairy tale",
    "max_tokens": 16,
    "temperature": 0
}""")
panel_3 = Panel("https://api.openai.com/v1/completions")
concatenate = Concatenate(FragmentA="Bearer ", FragmentB=environment_variable)
number_slider = Slider(10000, range=0..10000)
concatenate_2 = Concatenate(FragmentA="Bearer ", FragmentB=environment_variable_2)
http_get_request_async = HTTPGETRequestAsync(Send=Toggle(False), Url=panel, Authorization=concatenate_2, Timeout=10000)
http_get = HTTPGET(Send=Toggle(False), Url="http://www.parametric.camp", Timeout=10000)
http_get_request_async_2 = HTTPGETRequestAsync(Send=Toggle(False), Url="http://www.parametric.camp", Timeout=10000)
httppostrequest_async = HTTPPostRequestAsync(
    Send=Toggle(False),
    Url=panel_3,
    Body=panel_2,
    ContentType="application/json",
    Authorization=concatenate,
    Timeout=number_slider)
httppostrequest = HTTPPostRequestComponent(
    Send=Toggle(False),
    Url=panel_3,
    Body=panel_2,
    ContentType="application/json",
    Authorization=concatenate,
    Timeout=number_slider)
panel_4 = Panel(http_get_request_async_2)
panel_5 = Panel(http_get_request_async)
panel_6 = Panel(http_get)
deserialize_json = DeserializeJson(JSON=http_get_request_async, OutputsLocked=False)  # -> Data, Meta
deserialize_json_2 = DeserializeJson(JSON=httppostrequest, OutputsLocked=False)  # -> Id, Object, Created, Model, Choices, Usage
deserialize_json_3 = DeserializeJson(JSON=httppostrequest_async, OutputsLocked=False)  # -> Id, Object, Created, Model, Choices, Usage
panel_7 = Panel(httppostrequest_async)
deserialize_json_4 = DeserializeJson(JSON=deserialize_json.Data, OutputsLocked=False)  # -> Edit_history_tweet_ids, Id, Text
deserialize_json_5 = DeserializeJson(JSON=deserialize_json_2.Choices, OutputsLocked=False)  # -> Text, Index, Logprobs, Finish_reason
deserialize_json_6 = DeserializeJson(JSON=deserialize_json_3.Choices, OutputsLocked=False)  # -> Text, Index, Logprobs, Finish_reason
panel_8 = Panel(deserialize_json_5.Text)
panel_9 = Panel(deserialize_json_6.Text)
panel_10 = Panel(deserialize_json_4.Text)
